# Grasshopper definition ProteinGenerator.gh (Grasshopper 1.0.7)
# Copyright: Use it.  Mod it.  Share it. Just please give credit and keep this party going.
# Copyright: Use it.  Mod it.  Share it. Just please give credit and kepp this party going.
# plug-ins: Human UI, FalseStartToggle, MetaHopper

# ----
# Visualisation Parameters
colour_swatch = ColourSwatch(SwatchColor=RGB(255, 0, 68))
size_of_main_chain_aa = Slider(0.5, range=0..1)
create_color_picker = CreateColorPicker(
    DefaultColor=colour_swatch,
    AvailableColors=[RGB(255, 0, 0), RGB(0, 128, 0), RGB(0, 255, 255), RGB(128, 128, 128), RGB(255, 255, 0)])
create_color_picker_2 = CreateColorPicker(
    DefaultColor=colour_swatch,
    AvailableColors=[RGB(255, 0, 0), RGB(0, 128, 0), RGB(0, 255, 255), RGB(128, 128, 128), RGB(255, 255, 0)])
create_color_picker_3 = CreateColorPicker(
    DefaultColor=colour_swatch,
    AvailableColors=[RGB(255, 0, 0), RGB(0, 255, 0), RGB(0, 255, 255), RGB(128, 128, 128), RGB(255, 255, 0)])
value_listener = ValueListener(Elements=create_color_picker_3, SomeProperty=True)  # -> Values, Indices
value_listener_2 = ValueListener(Elements=create_color_picker, SomeProperty=True)  # -> Values, Indices
value_listener_3 = ValueListener(Elements=create_color_picker_2, SomeProperty=True)  # -> Values, Indices
create_slider = CreateSlider(Slider=size_of_main_chain_aa, ShowBounds=False, ShowTicks=False, ShowTooltip=False, ShowValLabel=True, showLabel=True)
value_listener_4 = ValueListener(Elements=create_slider, SomeProperty=True)  # -> Values, Indices
create_toggle = CreateToggle(Default=Toggle(False), Label="Record state")
create_toggle_2 = CreateToggle(Default=Toggle(False), Label="Σ Data")
create_toggle_3 = CreateToggle(Default=Toggle(False), Label="Data per slice")
create_toggle_4 = CreateToggle(Default=Toggle(False), Label="Show previous state")
create_toggle_5 = CreateToggle(Default=Toggle(True), Label="Secondary Structure")
create_toggle_6 = CreateToggle(Default=Toggle(False), Label="Side Chains")
create_toggle_7 = CreateToggle(Default=Toggle(False), Label="Primary Structure")
merge = Merge(Data1=value_listener.Values, Data2=value_listener_2.Values, Data3=value_listener_3.Values, Data4=colour_swatch)  # -> flatten(Result)
merge_2 = Merge(Data1=flatten(create_color_picker_3), Data2=flatten(create_color_picker), Data3=flatten(create_color_picker_2))
value_listener_5 = ValueListener(Elements=create_toggle_3, SomeProperty=True)  # -> Values, Indices
value_listener_6 = ValueListener(Elements=create_toggle_4, SomeProperty=True)  # -> Values, Indices
cluster = Cluster_2(ui_elements=merge_2)
value_listener_7 = ValueListener(Elements=create_toggle, SomeProperty=True)  # -> Values, Indices
value_listener_8 = ValueListener(Elements=create_toggle_5, SomeProperty=True)  # -> Values, Indices
value_listener_9 = ValueListener(Elements=create_toggle_6, SomeProperty=True)  # -> Values, Indices
value_listener_10 = ValueListener(Elements=create_toggle_2, SomeProperty=True)  # -> Values, Indices
value_listener_11 = ValueListener(Elements=create_toggle_7, SomeProperty=True)  # -> Values, Indices
enable_disable_object = EnableDisableObject(Enabled=value_listener_10.Values, AllObjects_Object=cloud_display_6)
hide_show_object_preview = HideShowObjectPreview(Visible=value_listener_6.Values, AllObjects_Object=[cloud_display_3, cloud_display_2, cloud_display])
hide_show_object_preview_2 = HideShowObjectPreview(Visible=value_listener_8.Values, AllObjects_Object=protein_ribbon)
enable_disable_object_2 = EnableDisableObject(Enabled=value_listener_11.Values, AllObjects_Object=[list_item_4, list_item_5, list_item_6])
enable_disable_object_3 = EnableDisableObject(Enabled=value_listener_5.Values, AllObjects_Object=cloud_display_5)
enable_disable_object_4 = EnableDisableObject(Enabled=value_listener_9.Values, AllObjects_Object=[line, graft_tree])
enable_disable_object_5 = EnableDisableObject(Enabled=value_listener_7.Values, AllObjects_Object=[cloud_display_3, cloud_display_2, cloud_display])
merge_3 = Merge(
    Data1=cluster,
    Data2=flatten(create_slider),
    Data3=flatten(create_toggle_5),
    Data4=flatten(create_toggle_7),
    Data5=flatten(create_toggle_6),
    Data6=flatten(create_toggle_2),
    Data7=flatten(create_toggle_3),
    Data8=flatten(create_toggle),
    Data9=flatten(create_toggle_4))
enable_disable_object_6 = EnableDisableObject(AllObjects_Object=protein_ribbon)
create_expander = CreateExpander(UIElements=merge_3, Header="VISUALISATION PARAMETERS", Open=True)

# ----
# Interpolation Parameters
random_seed = Slider(0.5, range=0..1)
create_color_picker_4 = CreateColorPicker()
create_slider_2 = CreateSlider(Slider=random_seed, ShowBounds=False, ShowTicks=False, ShowTooltip=False, ShowValLabel=True, showLabel=True)
value_listener_12 = ValueListener(Elements=create_slider_2, SomeProperty=True)  # -> Values, Indices
merge_4 = Merge(Data1=flatten(create_color_picker_4), Data2=flatten(create_slider_2))
false_start_toggle = FalseStartToggle(False)
create_expander_2 = CreateExpander(UIElements=merge_4, Header="INTERPOLATION PARAMETERS", Open=false_start_toggle)

# ----
# Use the ANIMATE slider to
# interpolate between states
animate = Slider(0.8, range=0..1)
create_slider_3 = CreateSlider(Slider=animate, ShowBounds=False, ShowTicks=False, ShowTooltip=False, ShowValLabel=True, showLabel=True)
value_listener_13 = ValueListener(Elements=create_slider_3, SomeProperty=True)  # -> Values, Indices

pan = Panel("""GLN
HIS
THR
VAL
MET""")
chart_type = ValueList({"Pie Chart": 0, "Horizontal Bar Chart": 1, "Vertical Bar Chart": 2, "Doughnut Chart": 3, "Gauge Chart": 4}, selected="Vertical Bar Chart")
pan_2 = Panel("""342
431
554
123
34""")
create_chart = CreateChart(Data=pan_2, Names=pan, Title="Protein", SubTitle="Heavy water", ChartType=chart_type)

hide_show_object_preview_3 = HideShowObjectPreview(Visible=Toggle(True), AllObjects_Object=[sphere_3, sphere_4, sphere_2])
listtotree = GhPythonScript()  # -> output; inputs Lists: list
# ---------- listtotree: Python ----------
__author__ = "Flora"
__version__ = "2021.01.18"

import rhinoscriptsyntax as rs



#Created By piac
#from https://gist.github.com/piac/ef91ac83cb5ee92a1294
def list_to_tree(input, none_and_holes=True, source=[0]):
    """Transforms nestings of lists or tuples to a Grasshopper DataTree"""
    from Grasshopper import DataTree as Tree
    from Grasshopper.Kernel.Data import GH_Path as Path
    from System import Array
    def proc(input,tree,track):
        path = Path(Array[int](track))
        if len(input) == 0 and none_and_holes: tree.EnsurePath(path); return
        for i,item in enumerate(input):
            if hasattr(item, '__iter__'): #if list or tuple
                track.append(i); proc(item,tree,track); track.pop()
            else:
                if none_and_holes: tree.Insert(item,path,i)
                elif item is not None: tree.Add(item,path)
    if input is not None: t=Tree[object]();proc(input,t,source[:]);return t

output=list_to_tree(Lists)
# ---------- end listtotree ----------
create_stack = CreateStack(Horizontal=True)
multiplylist = GhPythonScript(tree=listtotree)  # -> tree, multipliedList; inputs tree: tree
# ---------- multiplylist: Python ----------
__author__ = "Flora"
__version__ = "2021.01.18"

import rhinoscriptsyntax as rs

for i in range(tree.BranchCount):
    #subList=[]
    print(i)
    #for ii in tree.Branch(i):
    #    subList.append(list[i])
    #multipliedList.append(subList)

#multipliedList=list_to_tree(multipliedList)
# ---------- end multiplylist ----------

# ----
# INTERFACE
# 3D View
size_of_chain_lines = Slider(0.04, range=0.01..1)
mesh_sphere = MeshSphere(Base=PlaneXY(0, 0, 0), Radius=10, UCount=10, VCount=20)
create_3d_view = Create3DView(
    MeshToDisplay=mesh_sphere,
    MeshColors=RGB(255, 0, 0),
    ViewWidth=Slider(685, range=0..1000),
    ViewHeight=Slider(331, range=0..1000))

# ---- group: 3DView Window
launch_window = LaunchWindow(
    Show=Toggle(False),
    Name="Control Window",
    Width=Slider(727, range=0..1000),
    Height=Slider(427, range=0..1000),
    ChildStatus=0,
    EnableHorizScroll=False)
create_expander_3 = CreateExpander(UIElements=create_3d_view, Header="3D VIEW", Open=True)
add_elements = AddElements(Window=launch_window, Elements=flatten(create_expander_3), DoVLChecking=True)  # -> AddedElements, ElementNames

# ----
aa_range = Domain(Domain(0, 100))
aa_range_2 = Domain(Domain(0, 300))
create_range_slider = CreateRangeSlider(SliderRange=aa_range_2, StartingRange=aa_range)  # disabled
create_text_box = CreateTextBox(Label="Slices stack", DefaultText="40:180", UpdateButton=True, showLabel=True)
value_listener_14 = ValueListener(Elements=create_range_slider, SomeProperty=True)  # -> Values, Indices; disabled
value_listener_15 = ValueListener(Elements=create_text_box, SomeProperty=True)  # -> Values, Indices
text_split = TextSplit(Text=value_listener_15.Values, Separators=",")
number_slider = Slider(145, range=0..1000)
number_slider_2 = Slider(102, range=0..400)
number_slider_3 = Slider(93, range=0..1000)
panel = Panel("""0
0
1
1""")
panel_2 = Panel("""0
1
0
1""")

# ---- group: State Data
# PARSE DATA
# Input State data
# path (csv)
panel_3 = Panel("C:\Users\Flora\OneDrive - The Alan Turing Institute\Turing\1.Projects\3.Protein_folding\1.Data\GlyP_state_data_all_concentrations.csv")
state_reader = StateReader(path=panel_3)  # -> start_aa_3, end_aa_3, state_3, uptake_3, centre_3, exposure_3
create_set = CreateSet(List=state_reader.state_3)  # -> Set, Map
panel_4 = Panel(create_set.Set)
slice_no = Slider(10, range=0..190)
number_slider_4 = Slider(47, range=0..1000)

# ----
create_pulldown_menu = CreatePulldownMenu(Label="Experiment", ListItems=create_set.Set, showLabel=True)
merge_5 = Merge(Data2=create_text_box, Data3=create_pulldown_menu)  # -> flatten(Result)
create_grid = CreateGrid(
    UIElements=merge_5,
    RowDefinitions=Slider(153, range=0..1000),
    ColumnDefinitions=[Slider(188, range=0..1000), Slider(239, range=0..1000)],
    ElementRow=panel,
    ElementColumn=panel_2,
    ElementRowSpan=1,
    ElementColumnSpan=1)
adjust_element_positioning = AdjustElementPositioning(
    ElementsToAdjust=create_grid,
    Margin="10",
    AbsolutePositioning=False,
    Width=Slider(1391, range=0..10000),
    Height=Slider(163, range=0..1000))

# ---- group: State Data / Creates series of AA from start to end AA
subtraction = Subtraction(A=state_reader.end_aa_3, B=state_reader.start_aa_3)
addition = Addition(A=subtraction, B=1)
series = Series(Start=state_reader.start_aa_3, Step=1, Count=addition)

# ---- group: State Data / Seperates list per Exposure
create_set_2 = CreateSet(List=state_reader.exposure_3)  # -> Set, Map
equality = Equality(FirstNumber=graft(create_set_2.Set), SecondNumber=state_reader.exposure_3)  # -> Equality, Inequality

# ----
merge_6 = Merge(Data1=flatten(create_chart), Data2=flatten(create_slider_3), Data3=flatten(create_grid))
create_expander_4 = CreateExpander(UIElements=merge_6, Header="UI Controls", Open=True)

# ---- group: UI Sliders Window
# Set the toggle to the right to "True" to launch the window.
number_slider_5 = Slider(765, range=0..1000)
merge_7 = Merge(Data1=flatten(create_expander_4), Data2=flatten(create_expander), Data3=flatten(create_expander_2))
launch_window_2 = LaunchWindow(
    Show=Toggle(False),
    Name="Control Window",
    Width=Slider(428, range=0..1000),
    Height=number_slider_5,
    ChildStatus=0,
    EnableHorizScroll=False)
add_elements_2 = AddElements(Window=launch_window_2, Elements=flatten(merge_7), DoVLChecking=True)  # -> AddedElements, ElementNames

# ---- group: PDB parser
# PARSE PDB
# Input Active (End) state
# PDB path
# Input Inactive state
# PDB path
panel_5 = Panel("C:\Users\Flora\OneDrive - The Alan Turing Institute\Turing\1.Projects\3.Protein_folding\1.Data\GlyP_AMP.pdb")
panel_6 = Panel("C:\Users\Flora\OneDrive - The Alan Turing Institute\Turing\1.Projects\3.Protein_folding\1.Data\GlyP_G6P.pdb")
pdb_reader = PDB_Reader(pdb_path=panel_5)  # -> atom_order_3, aa_number_2, aa_name_2, xyz_point, atoms_name_2
pdb_reader_2 = PDB_Reader(pdb_path=panel_6)  # -> atom_order_3, aa_number_2, aa_name_2, xyz_point, atoms_name_2
aa_range_3 = Domain(Domain(0, 600))
filter_aa_properties = GhPythonScript(
    AA=pdb_reader.aa_number_2,
    AA_name=pdb_reader.aa_name_2,
    xyz=pdb_reader.xyz_point,
    atoms=pdb_reader.atoms_name_2,
    mask=aa_range_3)  # -> out, atoms_xyz_list, atoms_name_list, amino_list; inputs AA: list of Int32, AA_name: list, xyz: list, atoms: list
#   port AA: Amino Acid names
# ---------- filter_aa_properties: Python ----------
__author__ = "Flora"
__version__ = "2020.10.28"

"""
This module reads PDB output lists and creates double lists of AA coordinates and 
properties per AA atom, ready to be converted to trees.
eg. [['75.814,-34.543,47.16', '74.639,-34.529,48.079'...],[...]]
    Inputs:
        AA: Amino Acid id number (int list)
        AA_name: Amino Acid name (string list)
        xyz: coordinates in 3Dspace per atom (3d point rhino item)
        atoms: atom names (string list)
    Output:
        a: xyz coordinates for debug
        start: list of coordinates of all atoms per AA (for starting points 
        of lines)
        end: list of coordinates of all atoms per AA (for ending poins of lines)
"""


import rhinoscriptsyntax as rs

counter=-1

amino_list=[]

atom_xyz_list=[]
atoms_xyz_list=[]
atom_name_list=[]
atoms_name_list=[]

temp = []


#TODO: seperate per protein ("TER") 

# store list of atoms per aminoacid
for i in range (len(xyz)):
    if AA[i]!=counter: #a new aminoacid
        if atom_xyz_list != []:
            atoms_xyz_list.append(atom_xyz_list) #store list of atoms per AA
            atoms_name_list.append(atom_name_list)
        counter=AA[i]
        atom_xyz_list=[]
        atom_name_list=[]
        atom_xyz_list.append(xyz[i])
        atom_name_list.append(atoms[i])

        amino_list.append(AA_name[i]) #stores name per chain of AA
    else: # existing aminoacid
        atom_xyz_list.append(xyz[i])
        atom_name_list.append(atoms[i])

atoms_xyz_list.append(atom_xyz_list) #store list of atoms of final AA
atoms_name_list.append(atom_name_list)#store list of atoms names of final AA


if (mask!= None) :

    atoms_xyz_list = atoms_xyz_list[int(mask[0]):int(mask[1])]
    #print (atoms_xyz_list)
    atoms_name_list=atoms_name_list[int(mask[0]):int(mask[1])]
    amino_list=amino_list [int(mask[0]):int(mask[1])]

else: 
    None
# ---------- end filter_aa_properties ----------
filter_aa_properties_2 = GhPythonScript(
    AA=pdb_reader_2.aa_number_2,
    AA_name=pdb_reader_2.aa_name_2,
    xyz=pdb_reader_2.xyz_point,
    atoms=pdb_reader_2.atoms_name_2,
    mask=aa_range_3)  # -> out, atoms_xyz_list, atoms_name_list, amino_list; inputs AA: list of Int32, AA_name: list, xyz: list, atoms: list
#   port AA: Amino Acid names
# ---------- filter_aa_properties_2: Python ----------
__author__ = "Flora"
__version__ = "2020.10.28"

"""
This script stores lists of the AA coordinates and properties per AA atom.
eg. [['75.814,-34.543,47.16', '74.639,-34.529,48.079'...],[...]]
    Inputs:
        AA: Amino Acid id number (int list)
        AA_name: Amino Acid name (string list)
        xyz: coordinates in 3Dspace per atom (3d point rhino item)
        atoms: atom names (string list)
    Output:
        a: xyz coordinates for debug
        start: list of coordinates of all atoms per AA (for starting points 
        of lines)
        end: list of coordinates of all atoms per AA (for ending poins of lines)
"""


import rhinoscriptsyntax as rs

counter=-1

amino_list=[]

atom_xyz_list=[]
atoms_xyz_list=[]
atom_name_list=[]
atoms_name_list=[]

temp = []


#TODO: seperate per protein ("TER") 

# store list of atoms per aminoacid
for i in range (len(xyz)):
    if AA[i]!=counter: #a new aminoacid
        if atom_xyz_list != []:
            atoms_xyz_list.append(atom_xyz_list) #store list of atoms per AA
            atoms_name_list.append(atom_name_list)
        counter=AA[i]
        atom_xyz_list=[]
        atom_name_list=[]
        atom_xyz_list.append(xyz[i])
        atom_name_list.append(atoms[i])

        amino_list.append(AA_name[i]) #stores name per chain of AA
    else: # existing aminoacid
        atom_xyz_list.append(xyz[i])
        atom_name_list.append(atoms[i])

atoms_xyz_list.append(atom_xyz_list) #store list of atoms of final AA
atoms_name_list.append(atom_name_list)#store list of atoms names of final AA


if (mask!= None) :

    atoms_xyz_list = atoms_xyz_list[int(mask[0]):int(mask[1])]
    #print (atoms_xyz_list)
    atoms_name_list=atoms_name_list[int(mask[0]):int(mask[1])]
    amino_list=amino_list [int(mask[0]):int(mask[1])]

else: 
    None
# ---------- end filter_aa_properties_2 ----------
domain = Domain(text_split)
# Use this slider to control the size
# of the Amino Acid Spheres in the visualisation
size_of_main_chain_aa_2 = Slider(0.4, range=0..1)

# ---- group: PDB parser / Interpolation
animate_2 = Slider(0.3, range=0..1)
xyz_tree = GhPythonScript(xyz=filter_aa_properties.atoms_xyz_list)  # -> out, x_list, y_list, z_list; inputs xyz: list
# ---------- xyz_tree: Python ----------
__author__ = "Flora"
__version__ = "2020.10.28"

"""
This componment gets the x,y,z list and creates seperate x,y,z, lists per AA 
atom.
    Inputs:
        AA: Amino Acid id number (int list)
        AA_name: Amino Acid name (string list)
        xyz: coordinates in 3Dspace per atom (3d point rhino item)
        atoms: atom names (string list)
    Output:
        a: xyz coordinates for debug
        start: list of coordinates of all atoms per AA (for starting points of lines) 
        end: list of coordinates of all atoms per AA (for ending poins of lines)
"""


import rhinoscriptsyntax as rs


x_list,y_list,z_list=[],[],[]

def create_xyz_list():

    for i in range (len(xyz)):
        x1,y1,z1=[],[],[]
        for j in range (len(xyz[i])):
            if (xyz[i][j]!=None):
                xyz_str= str(xyz[i][j])
                x,y,z= xyz_str.split(",")
                x1.append(x)
                y1.append(y)
                z1.append(z)
            else:
                x1.append("Ter")
                y1.append("Ter")
                z1.append("Ter")
        x_list.append(x1)
        y_list.append(y1)
        z_list.append(z1)


create_xyz_list()
# ---------- end xyz_tree ----------
xyz_tree_2 = GhPythonScript(xyz=filter_aa_properties_2.atoms_xyz_list)  # -> out, x_list, y_list, z_list; inputs xyz: list
# ---------- xyz_tree_2: Python ----------
__author__ = "Flora"
__version__ = "2020.10.28"

"""
Provides a scripting component.
    Inputs:
        AA: Amino Acid id number (int list)
        AA_name: Amino Acid name (string list)
        xyz: coordinates in 3Dspace per atom (3d point rhino item)
        atoms: atom names (string list)
    Output:
        a: xyz coordinates for debug
        start: list of coordinates of all atoms per AA (for starting points of lines) 
        end: list of coordinates of all atoms per AA (for ending poins of lines)
"""


import rhinoscriptsyntax as rs


x_list,y_list,z_list=[],[],[]

def create_xyz_list():

    for i in range (len(xyz)):
        x1,y1,z1=[],[],[]
        for j in range (len(xyz[i])):
            if (xyz[i][j]!=None):
                xyz_str= str(xyz[i][j])
                x,y,z= xyz_str.split(",")
                x1.append(x)
                y1.append(y)
                z1.append(z)
            else:
                x1.append("None")
        x_list.append(x1)
        y_list.append(y1)
        z_list.append(z1)

create_xyz_list()
# ---------- end xyz_tree_2 ----------
linear_interpolation = GhPythonScript(
    x1=xyz_tree.x_list,
    x2=xyz_tree_2.x_list,
    y1=xyz_tree.y_list,
    y2=xyz_tree_2.y_list,
    z1=xyz_tree.z_list,
    z2=xyz_tree_2.z_list,
    a=value_listener_12.Values,
    p=animate_2)  # -> out, xyz_list; inputs x1: list, x2: list, y1: list, y2: list, z1: list, z2: list
# ---------- linear_interpolation: Python ----------
"""Simple Linear Interpolator.
    Inputs:
        x: The x script variable
        y: The y script variable
        z: The z script variable
    Output:
        xyz_list: new xyz coordinates"""

__author__ = "Flora"
__version__ = "2020.11.12"

import rhinoscriptsyntax as rs

x,y,z=[],[],[]
#x=p*(x2-x1)+x1
for i in range(len(x1)):
    xyz_temp=[]
    for j in range (len(x1[i])):
        if x1[i][j]!= "Ter":
            x1f= float(x1[i][j])+a
            x2f= float(x2[i][j])+a
            x_new=p*(x2f-x1f)+x1f

            y1f= float(y1[i][j])
            y2f= float(y2[i][j])
            y_new=p*(y2f-y1f)+y1f
            
            z1f= float(z1[i][j])
            z2f= float(z2[i][j])
            z_new=p*(z2f-z1f)+z1f
            
            xyz_temp.append("%s,%s,%s" %(x_new,y_new,z_new))
        else:
            x.append("Ter")
    x.append(xyz_temp)


#Originally Created By piac
#from https://gist.github.com/piac/ef91ac83cb5ee92a1294
#NOTE: for later use
def list_to_tree(input, none_and_holes=True, source=[0]):
    """Transforms nestings of lists or tuples to a Grasshopper DataTree"""
    from Grasshopper import DataTree as Tree
    from Grasshopper.Kernel.Data import GH_Path as Path
    from System import Array
    def proc(input,tree,track):
        path = Path(Array[int](track))
        if len(input) == 0 and none_and_holes: tree.EnsurePath(path); return
        for i,item in enumerate(input):
            if hasattr(item, '__iter__'): #if list or tuple
                track.append(i); proc(item,tree,track); track.pop()
            else:
                if none_and_holes: tree.Insert(item,path,i)
                elif item is not None: tree.Add(item,path)
    if input is not None: t=Tree[object]();proc(input,t,source[:]);return t

xyz_list=x

#list_to_tree(x)
# ---------- end linear_interpolation ----------

# ---- group: PDB parser
aa_range_4 = Slider(27, range=0..100)
sidechains_to_trees = GhPythonScript(
    AA_slider=aa_range_4,
    atoms_xyz_list=linear_interpolation.xyz_list,
    atoms_name_list=filter_aa_properties.atoms_name_list,
    amino_list=filter_aa_properties.amino_list)  # -> out, AA_name, start, end, atom_names, atom_xyz; inputs AA_slider: Int32, atoms_xyz_list: list, atoms_name_list: list, amino_list: list
# ---------- sidechains_to_trees: Python ----------
__author__ = "Flora"
__version__ = "2020.10.28"

"""
Provides a scripting component.
    Inputs:
        AA: Amino Acid id number (int list)
        AA_name: Amino Acid name (string list)
        xyz: coordinates in 3Dspace per atom (3d point rhino item)
        atoms: atom names (string list)
    Output:
        a: xyz coordinates for debug
        start: list of coordinates of all atoms per AA (for starting points of lines) 
        end: list of coordinates of all atoms per AA (for ending poins of lines)
"""


import rhinoscriptsyntax as rs


sidechains_dict = {
"GLN":{"A": ["C","C","CA","CA","CB","CG","CD","CD"],
    "B":["O","CA","N","CB","CG","CD","NE2","OE1"]},
"GLU":{"A": ["C","C","CA","CA","CB","CG","CD","CD"],
    "B":["O","CA","N","CB","CG","CD","OE2","OE1"]},
"LYS":{"A": ["C","C","CA","CA","CB","CG","CD","CE"],
    "B": ["O","CA","N","CB","CG","CD","CE","NZ"]},
"ARG":{"A":["C","C","CA","CA","CB","CG","CD","NE","CZ","CZ"],
    "B": ["O","CA","N","CB","CG","CD","NE","CZ","NH1","NH2"]},
"ILE":{"A": ["C","C","CA","CA","CB","CB","CG1"],
    "B": ["O","CA","N","CB","CG1","CG2","CD1"]},
"SER":{"A": ["C","C","CA","CA","CB"],
    "B": ["O","CA","N","CB","OG"]},
"VAL":{"A": ["C","C","CA","CA","CB","CB"],
    "B": ["O","CA","N","CB","CG2","CG1"]},
"HIS": {"A": ["C","C","CA","CA","CB","CG","CG","CD2","CE1","ND1"], 
    "B": ["O","CA","N","CB","CG","ND1","CD2","NE2","NE2","CE1"]},
"GLY":{"A":["C","C","CA"],
    "B": ["O","CA","N"]},
"LEU":{"A": ["C","C","CA","CA","CB","CG","CG"],
    "B": ["O","CA","N","CB","CG","CD1","CD2"]},
"ALA":{"A": ["C","C","CA","CA"],
    "B": ["O","CA","N","CB"]},
"ASN":{"A": ["C","C","CA","CA","CB","CG","CG"],
    "B": ["O","CA","N","CB","CG","OD1","ND2"]},
"THR":{"A": ["C","C","CA","CA","CB","CB"],
    "B": ["O","CA","N","CB","CG2","OG1"]},
"PRO":{"A": ["C","C","CA","CA","CB","CG","CD"],
    "B": ["O","CA","N","CB","CG","CD","N"]},
"ASP":{"A":["C","C","CA","CA","CB","CG","CG"],
    "B": ["O","CA","N","CB","CG","OD1","OD2"]},
"TYR":{"A": ["C","C","CA","CA","CB","CG","CG","CD1","CD2","CE1","CE2","CZ"],
    "B": ["O","CA","N","CB","CG","CD1","CD2","CE1","CE2","CZ","CZ","OH"]},
"PHE":{"A": ["C","C","CA","CA","CB","CG","CG","CD1","CD2","CE1","CE2"],
    "B": ["O","CA","N","CB","CG","CD1","CD2","CE1","CE2","CZ","CZ"]},
"TRP":{"A": ["C","C","CA","CA","CB","CG","CG","CD1","CD2","NE1","CD2","CE2","CE3","CZ3","CH2"], 
    "B": ["O","CA","N","CB","CG","CD2","CD1","NE1","CE2","CE2","CE3","CZ2","CZ3","CH2","CZ2"]},
}



amino_start =[]
amino_end=[]

atom_names=[]
atom_xyz=[]
AA_sublist=[]



def construct_sidechains_points():
    None

def construct_sidechains(amino_list,atoms_name_list,atoms_xyz_list):

    for i in range (len(amino_list)): #(AA_slider): 
        amino_acid = sidechains_dict.get(amino_list[i])
        
        if(amino_acid != None): #if the amino acid exists in the pdb exists in the current dictionary
            AA_sublist.append(amino_list[i])
            
            A = amino_acid.get('A') #get the list of the first points of the AA
            B = amino_acid.get('B') #get the list of the second points of the AA
            atom_list = atoms_name_list[i]
            xyz_list = atoms_xyz_list[i]
            

            #fix beggining and end for lines
            start, end= sidechain(amino_acid,A,B,atom_list,xyz_list)
             
            amino_start.append(start)
            amino_end.append(end)
            
            atom_names.append(atom_list)
            atom_xyz.append(xyz_list)

        else: error = "Amino Acid doesnt exist"

def sidechain(amino_acid,A,B,atom_list,xyz_list):
    start, end=[],[]
    for x in range (len(A)):
        for y in range (len(atom_list)):  #atom_list to change with slider
            if (A[x]==atom_list[y]):
                start.append(xyz_list[y])
            if (B[x]==atom_list[y]):
                end.append(xyz_list[y])
    return (start,end)


#Created By piac
#from https://gist.github.com/piac/ef91ac83cb5ee92a1294
def list_to_tree(input, none_and_holes=True, source=[0]):
    """Transforms nestings of lists or tuples to a Grasshopper DataTree"""
    from Grasshopper import DataTree as Tree
    from Grasshopper.Kernel.Data import GH_Path as Path
    from System import Array
    def proc(input,tree,track):
        path = Path(Array[int](track))
        if len(input) == 0 and none_and_holes: tree.EnsurePath(path); return
        for i,item in enumerate(input):
            if hasattr(item, '__iter__'): #if list or tuple
                track.append(i); proc(item,tree,track); track.pop()
            else:
                if none_and_holes: tree.Insert(item,path,i)
                elif item is not None: tree.Add(item,path)
    if input is not None: t=Tree[object]();proc(input,t,source[:]);return t

#print (atoms_xyz_list)
#sidechain(atoms_xyz_list, amino_names, atoms_name_list)
construct_sidechains(amino_list,atoms_name_list,atoms_xyz_list)

atom_names=list_to_tree(atom_names)
atom_xyz=list_to_tree(atom_xyz)
AA_name=list_to_tree(AA_sublist)
start= list_to_tree(amino_start)
end=list_to_tree(amino_end)


#print (atoms_xyz_list)
# ---------- end sidechains_to_trees ----------

# ----
data_recorder = DataRecorder(linear_interpolation.xyz_list, DataLimit=-10, RecordData=False)
panel_7 = Panel(domain)

# ---- group: State Data (continued)
panel_8 = Panel(create_set_2.Set)
panel_9 = Panel(equality.Equality)
panel_10 = Panel(series)

# ---- group: State Data / Select Exposure
cull_pattern = CullPattern(List=state_reader.centre_3, CullPattern=equality.Equality)
explode_tree = ExplodeTree(Data=cull_pattern)  # -> Branch0, Branch1, Branch2, Branch3, Branch4, Branch5, Branch6, Branch7

# ---- group: PDB parser (continued)
cluster_2 = Cluster(tree=sidechains_to_trees.end, domain=domain)
sub_list = SubList(List=sidechains_to_trees.AA_name, Domain=domain, Wrap=True)  # -> List, Index
cluster_3 = Cluster(tree=sidechains_to_trees.atom_names, domain=domain)
cluster_4 = Cluster(tree=sidechains_to_trees.start, domain=domain)
cluster_5 = Cluster(tree=sidechains_to_trees.atom_xyz, domain=domain)
sphere = Sphere(Base=cluster_5, Radius=0.2)  # disabled

# ----
stream_gate = StreamGate(Stream=cluster_5, Gate=0)  # -> Target0, Target1

# ---- group: State Data / Filter xyz per AA order in data
xyzpoints = Point(stream_gate.Target0)
treetolist = GhPythonScript(data=xyzpoints)  # -> output; inputs data: tree of Point3d
# ---------- treetolist: Python ----------
__author__ = "Flora"
__version__ = "2021.01.18"

import rhinoscriptsyntax as rs

#Created By piac
#from https://gist.github.com/piac/ef91ac83cb5ee92a1294
def list_to_tree(input, none_and_holes=True, source=[0]):
    """Transforms nestings of lists or tuples to a Grasshopper DataTree"""
    from Grasshopper import DataTree as Tree
    from Grasshopper.Kernel.Data import GH_Path as Path
    from System import Array
    def proc(input,tree,track):
        path = Path(Array[int](track))
        if len(input) == 0 and none_and_holes: tree.EnsurePath(path); return
        for i,item in enumerate(input):
            if hasattr(item, '__iter__'): #if list or tuple
                track.append(i); proc(item,tree,track); track.pop()
            else:
                if none_and_holes: tree.Insert(item,path,i)
                elif item is not None: tree.Add(item,path)
    if input is not None: t=Tree[object]();proc(input,t,source[:]);return t
    
#Created By piac
#from https://gist.github.com/piac/ef91ac83cb5ee92a1294
# written by Giulio Piacentino, giulio@mcneel.com
def tree_to_list(input, retrieve_base = lambda x: x[0]):
    """Returns a list representation of a Grasshopper DataTree"""
    def extend_at(path, index, simple_input, rest_list):
        target = path[index]
        if len(rest_list) <= target: rest_list.extend([None]*(target-len(rest_list)+1))
        if index == path.Length - 1:
            rest_list[target] = list(simple_input)
        else:
            if rest_list[target] is None: rest_list[target] = []
            extend_at(path, index+1, simple_input, rest_list[target])
    all = []
    for i in range(input.BranchCount):
        path = input.Path(i)
        extend_at(path, 0, input.Branch(path), all)
    return retrieve_base(all)

output=[]

output=tree_to_list(data)
# ---------- end treetolist ----------
selectionfromlists = GhPythonScript(Lists=treetolist, selection=series)  # -> output; inputs Lists: list, selection: tree
# ---------- selectionfromlists: Python ----------
__author__ = "Flora"
__version__ = "2021.01.18"

import rhinoscriptsyntax as rs

output=[]

for i in range(selection.BranchCount):
    subOutput=[]
    for ii in selection.Branch(i):
        number=int(ii)
        print(number)
        if number<len(Lists):
            subOutput.append(Lists[number])
    output.append(subOutput)

#Created By piac
#from https://gist.github.com/piac/ef91ac83cb5ee92a1294
def list_to_tree(input, none_and_holes=True, source=[0]):
    """Transforms nestings of lists or tuples to a Grasshopper DataTree"""
    from Grasshopper import DataTree as Tree
    from Grasshopper.Kernel.Data import GH_Path as Path
    from System import Array
    def proc(input,tree,track):
        path = Path(Array[int](track))
        if len(input) == 0 and none_and_holes: tree.EnsurePath(path); return
        for i,item in enumerate(input):
            if hasattr(item, '__iter__'): #if list or tuple
                track.append(i); proc(item,tree,track); track.pop()
            else:
                if none_and_holes: tree.Insert(item,path,i)
                elif item is not None: tree.Add(item,path)
    if input is not None: t=Tree[object]();proc(input,t,source[:]);return t


#output=list_to_tree(output)
# ---------- end selectionfromlists ----------

# ---- group: State Data / Select Exposure (continued)
cull_pattern_2 = CullPattern(List=selectionfromlists, CullPattern=equality.Equality)
explode_tree_2 = ExplodeTree(Data=cull_pattern_2)  # -> Branch0, Branch1, Branch2, Branch3, Branch4, Branch5, Branch6, Branch7

# ---- group: PDB parser
panel_11 = Panel("""C
CA
N""")
find_aa_index = GhPythonScript(input=cluster_3, search=panel_11)  # -> output; inputs input: list, search: list
# ---------- find_aa_index: Python ----------
__author__ = "Flora"
__version__ = "2020.10.27"

import rhinoscriptsyntax as rs

output=[]

for i in range(len(input)):
    for j in range (len(search)):    
        if input[i] == search[j]: #.find(search)!=-1:
            #print (input[i])
            output.append(i)
# ---------- end find_aa_index ----------
list_item = ListItem(List=stream_gate.Target0, Index=find_aa_index, Wrap=True)  # -> flatten(Item)
size_of_chain_lines_2 = Slider(0.18, range=0.01..1)
list_item_2 = ListItem(List=list_item, Index=0, Wrap=True)
polyline = PolyLine(Vertices=list_item, Closed=False)
circle = Circle(Plane=list_item_2, Radius=size_of_chain_lines_2)
extrude_along = ExtrudeAlong(Base=circle, Curve=polyline)  # -> flatten(Extrusion)

# ---- group: PDB parser / Clashes
find_aa_index_2 = GhPythonScript(input=cluster_3, search="CA")  # -> output; inputs input: list
# ---------- find_aa_index_2: Python ----------
__author__ = "Flora"
__version__ = "2020.10.27"

import rhinoscriptsyntax as rs

output=[]

for i in range(len(input)):
    if input[i] == search: #.find(search)!=-1:
        #print (input[i])
        output.append(i)
# ---------- end find_aa_index_2 ----------
list_item_3 = ListItem(List=stream_gate.Target0, Index=find_aa_index_2, Wrap=True)  # -> flatten(Item)
clashes = GhPythonScript(
    AA_name=sub_list.List,
    CA_xyz=list_item_3,
    clash_th=Slider(0, range=0..5),
    break_th=Slider(7.592, range=0..10),
    e=Slider(0.25, range=0..1))  # -> out, clash, breakbond; inputs AA_name: list, CA_xyz: list
# ---------- clashes: Python ----------
"""Module to calculate Energy and find Clashes of AA in pdb files in Proteins .
    Inputs:
        CA_xyz: list (str) of xyz cooridnates of CA
        clash_th: (float) clash threshhold
        break_th: (float) break threshold
        AA_name: list(str) of AA

    Output:
        clash: a list of AA coord of clashes
        breakbond: a list of AA coord of breaks"""

__author__ = "Flora"
__version__ = "2021.04.28"

import rhinoscriptsyntax as rs
import math 
import Grasshopper.Kernel as gh

print AA_name

def SplitCoordinates(xyz_str):
    """
    Function to split coord. str in float list
    xyz_str: (str) a list input of "x,y,z" coordinates
    """
    xyz = []
    for i in range (len(xyz_str)):
        x_,y_,z_ = xyz_str[i].split(",")
        xyz.append([float(x_),float(y_),float(z_)])
    return(xyz)

def CalcDistance(p1, p2):
    """
    Function to calculate distance in space between two points (p)
    p1, p2: (f) lists of coordinates for point1 and point2
    """
    dist = math.sqrt((p2[0]-p1[0])**2 + (p2[1]-p1[1])**2 + (p2[2]-p2[2])**2)
    return(dist)

def LennardJones (e, s, p1, p2):
    """
    Archetype model for simple yet realistic intermolecular interactions
    e: dispersion energy
    s: distance at which the particle-particle potential energy V is zero 
    (size of the particle) TODO: add list of molecules //usual s = 0.34nm
    p1,p2: centroid coordinates of two molecules
    
    V: potential energy
    """
    r = CalcDistance(p1,p2)
    V = 4*e*((s/r)**12 - (s/r)**6)
    return V


def CheckClash(xyz_str, xyz, thold, e):
    """
    Fuction to check for clashes by calculating minimum distance between each AA
    xyz_str: (str) list of xyz coordinates for gh output
    xyz: (f) a list of xyz coordinates
    
    e: LJ dispersion energy
    thold: (f) minimum distance threshold for a clash between two AA
    
    id, c: list of unique index and coordinates of clashed AA
    """
    c, id = [], []
   #append i and j to couple the 
    error = 0
    for i in range (len(xyz)):
        for j in range (i+1, len(xyz)):
            V = LennardJones (e,thold,xyz[i],xyz[j]) #TODO: replace thold with s
            if (V > thold):
                c.append(xyz_str[i])
                id.append(str(i))
                error=1
    if (error == 1):
        ErrorGh("Clash: ", id[0])
    return(set(c), set(id))


def CheckBreak(xyz_str, xyz, thold):
    """
    Function to check for bond breaks by calculating max distance between each AA
    xyz_str: (str) list of xyz coordinates for gh output
    xyz: (f) list of xyz coordinates of AA
    thold: (f) maximum distance threshold for a break between two AA
    
    id, b: list of unique index and coordinates of break bond in AA
    """
    b, id = [], []
    error = 0
    for i in range (len(xyz)-1):
        dist = CalcDistance(xyz[i],xyz[i+1])
        if (dist > thold):
            b.append(xyz_str[i])
            id.append(str(i))
            error=1
    if (error == 1):
        ErrorGh("Break: ", id[0])
    return (set(b), set(id))

def ErrorGh(m, d) :
    """
    Produces Grasshopper(gh) error and breaks the module
    """
    e = gh.GH_RuntimeMessageLevel.Error
    ghenv.Component.AddRuntimeMessage(e, m + str(d))

if __name__ == "__main__": 
    xyz = SplitCoordinates(CA_xyz)
    clash, cls_id = CheckClash(CA_xyz, xyz, clash_th, e)
    breakbond, brk_id = CheckBreak(CA_xyz, xyz, break_th)
# ---------- end clashes ----------

# ---- group: PDB parser / Backbone
find_aa_index_3 = GhPythonScript(input=cluster_3, search="N")  # -> output; inputs input: list; same code as find_aa_index_2
find_aa_index_4 = GhPythonScript(input=cluster_3, search="CA")  # -> output; inputs input: list; same code as find_aa_index_2
find_aa_index_5 = GhPythonScript(input=cluster_3, search="C")  # -> output; inputs input: list; same code as find_aa_index_2
list_item_4 = ListItem(List=stream_gate.Target0, Index=find_aa_index_3, Wrap=True)  # -> flatten(Item); disabled
list_item_5 = ListItem(List=stream_gate.Target0, Index=find_aa_index_4, Wrap=True)  # -> flatten(Item); disabled
list_item_6 = ListItem(List=stream_gate.Target0, Index=find_aa_index_5, Wrap=True)  # -> flatten(Item); disabled
cloud_display = CloudDisplay(Points=list_item_6, Colours=ColourSwatch(SwatchColor=RGB(21, 247, 0)), Size=size_of_main_chain_aa_2, SpriteType=0)  # disabled
cloud_display_2 = CloudDisplay(Points=list_item_5, Colours=ColourSwatch(SwatchColor=RGB(82, 209, 92)), Size=size_of_main_chain_aa_2, SpriteType=0)  # disabled
cloud_display_3 = CloudDisplay(Points=list_item_4, Colours=ColourSwatch(SwatchColor=RGB(21, 247, 0)), Size=size_of_main_chain_aa_2, SpriteType=0)  # disabled

# ---- group: PDB parser / Sidechains
line = Line(StartPoint=cluster_4, EndPoint=cluster_2)  # disabled
graft_tree = GraftTree(Tree=sub_list.List, IncludeEmptyLists=True, IncludeNullItems=True)  # disabled
cloud_display_4 = CloudDisplay(Points=cluster_5, Colours=RGB(255, 20, 147), Size=0.21, SpriteType=0)
merge_8 = Merge(Data1=graft_tree, Data2=line)

# ---- group: PDB parser (continued)
protein_ribbon = ProteinRibbon(
    location=PlaneXY(0, 0, 0),
    aapoints=stream_gate.Target0,
    threshold_count=6,
    threshold_angle_α_vs_β=0.95,
    alpha_helix_color=ColourSwatch(SwatchColor=RGB(49, 64, 224)),
    beta_sheet_color=ColourSwatch(SwatchColor=RGB(224, 210, 56)),
    loop_color=ColourSwatch(SwatchColor=RGB(70, 156, 83)))  # -> all_atom_points, amino_acid_residue_points, curve, ribbon
curve = Curve(line)
sphere_2 = Sphere(Base=list_item_6, Radius=value_listener_4.Values)
sphere_3 = Sphere(Base=list_item_4, Radius=value_listener_4.Values)
sphere_4 = Sphere(Base=list_item_5, Radius=value_listener_4.Values)

# ----
curve_2 = Curve(curve)
circle_2 = Circle(Plane=curve_2, Radius=size_of_chain_lines)
extrude_along_2 = ExtrudeAlong(Base=circle_2, Curve=curve_2)  # -> flatten(Extrusion)
mesh = Mesh(sphere_3)
mesh_2 = Mesh(sphere_4)
mesh_3 = Mesh(sphere_2)
mesh_join = MeshJoin(Meshes=mesh_2)
mesh_join_2 = MeshJoin(Meshes=extrude_along_2)
mesh_join_3 = MeshJoin(Meshes=mesh)
mesh_join_4 = MeshJoin(Meshes=mesh_3)
set_3d_view = Set3DView(_3DView=create_3d_view, MeshToDisplay=[mesh_join, mesh_join_3, mesh_join_4, mesh_join_2], MeshColors=merge)

line_dimension = LineDimension(Line=line, Text="{0:0.00}", Size=0.2)
ghpython_script = GhPythonScript(domain=domain, list_AA=list_item_4)  # -> out, b; inputs domain: list, list_AA: list
# ---------- ghpython_script: Python ----------
__author__ = "Flora"
__version__ = "2021.03.02"

import rhinoscriptsyntax as rs

series=[]
b=0
for i in domain: 
    #print i
    a= i[1]-i[0]
    series.append(a+b)
    b=a
    print b



#b=[[0 for j in range(list_AA)] for i in range(domain)]
#print b
for i in range(len(domain)):
    print i
#    for AA in range(series[i]):
#        print "hi"
        #print series[i]
#        for j in list_AA: 
#            b.append(5)
# ---------- end ghpython_script ----------
panel_12 = Panel(list_item_5)
sphere_5 = Sphere(Base=clashes.clash, Radius=1)
panel_13 = Panel(clashes.breakbond)

# ---- group: State Data (continued)
listtotree_2 = GhPythonScript(Lists=explode_tree_2.Branch0)  # -> output; inputs Lists: list; same code as listtotree
panel_14 = Panel(explode_tree.Branch0)
path_mapper = PathMapper(listtotree_2, source="{A;B;C}", target="{A;B}")
panel_15 = Panel(listtotree_2)
bounds = Bounds(Numbers=panel_14)
remap_numbers = RemapNumbers(Value=panel_14, Source=bounds, Target=Domain(0, 1))  # -> Mapped, Clipped
gradient = Gradient(LowerLimit=0, UpperLimit=1, Parameter=remap_numbers.Mapped, stops=[0: RGB(0, 128, 0), 1: RGB(255, 0, 0)])
selecttreesecondbranchonly = GhPythonScript(tree=listtotree_2, selection=slice_no)  # -> tree_output; inputs tree: tree
# ---------- selecttreesecondbranchonly: Python ----------
__author__ = "Flora"
__version__ = "2021.01.18"

import rhinoscriptsyntax as rs

#Created By piac
#from https://gist.github.com/piac/ef91ac83cb5ee92a1294
def list_to_tree(input, none_and_holes=True, source=[0]):
    """Transforms nestings of lists or tuples to a Grasshopper DataTree"""
    from Grasshopper import DataTree as Tree
    from Grasshopper.Kernel.Data import GH_Path as Path
    from System import Array
    def proc(input,tree,track):
        path = Path(Array[int](track))
        if len(input) == 0 and none_and_holes: tree.EnsurePath(path); return
        for i,item in enumerate(input):
            if hasattr(item, '__iter__'): #if list or tuple
                track.append(i); proc(item,tree,track); track.pop()
            else:
                if none_and_holes: tree.Insert(item,path,i)
                elif item is not None: tree.Add(item,path)
    if input is not None: t=Tree[object]();proc(input,t,source[:]);return t

#Created By piac
#from https://gist.github.com/piac/ef91ac83cb5ee92a1294
# written by Giulio Piacentino, giulio@mcneel.com
def tree_to_list(input, retrieve_base = lambda x: x[0]):
    """Returns a list representation of a Grasshopper DataTree"""
    def extend_at(path, index, simple_input, rest_list):
        target = path[index]
        if len(rest_list) <= target: rest_list.extend([None]*(target-len(rest_list)+1))
        if index == path.Length - 1:
            rest_list[target] = list(simple_input)
        else:
            if rest_list[target] is None: rest_list[target] = []
            extend_at(path, index+1, simple_input, rest_list[target])
    all = []
    for i in range(input.BranchCount):
        path = input.Path(i)
        extend_at(path, 0, input.Branch(path), all)
    return retrieve_base(all)

#tree=tree


#path1=[]
#for i in range(tree.BranchCount):
#    
#    path = tree.Path(i)
#    if len(path)>1 and path[1]=
#    
#    #print(path[1,-1])
#    print(path)
#    print(path[2])
#    #extend_at(path, 1, input.Branch(path), path1)


tree_output=[]
for i in range(tree.BranchCount):
    path = tree.Path(i)
    
    #print(str(path[1]) +" "+str(int(selection)))
    
    if str(path[1])==str(int(selection)):
        print(path[1])
        subTree=[]
        print(i)
        for ii in tree.Branch(i):
            subTree.append(ii)

        tree_output.append(subTree)

tree_output=list_to_tree(tree_output)
# ---------- end selecttreesecondbranchonly ----------

# ---- group: State Data / SelectTreeBranch
tree_statistics = TreeStatistics(Tree=listtotree_2)  # -> Paths, Length, Count
list_item_7 = ListItem(List=tree_statistics.Paths, Index=number_slider_4, Wrap=True)
tree_branch = TreeBranch(Tree=listtotree_2, Path=list_item_7, MaintainPaths=True)

# ---- group: State Data / slices viz
multiplylist_2 = GhPythonScript(selection=slice_no, tree=selecttreesecondbranchonly, list=gradient)  # -> tree_output, multipliedList; inputs tree: tree, list: list
# ---------- multiplylist_2: Python ----------
__author__ = "Flora"
__version__ = "2021.01.18"

import rhinoscriptsyntax as rs

#Created By piac
#from https://gist.github.com/piac/ef91ac83cb5ee92a1294
def list_to_tree(input, none_and_holes=True, source=[0]):
    """Transforms nestings of lists or tuples to a Grasshopper DataTree"""
    from Grasshopper import DataTree as Tree
    from Grasshopper.Kernel.Data import GH_Path as Path
    from System import Array
    def proc(input,tree,track):
        path = Path(Array[int](track))
        if len(input) == 0 and none_and_holes: tree.EnsurePath(path); return
        for i,item in enumerate(input):
            if hasattr(item, '__iter__'): #if list or tuple
                track.append(i); proc(item,tree,track); track.pop()
            else:
                if none_and_holes: tree.Insert(item,path,i)
                elif item is not None: tree.Add(item,path)
    if input is not None: t=Tree[object]();proc(input,t,source[:]);return t

#Created By piac
#from https://gist.github.com/piac/ef91ac83cb5ee92a1294
# written by Giulio Piacentino, giulio@mcneel.com
def tree_to_list(input, retrieve_base = lambda x: x[0]):
    """Returns a list representation of a Grasshopper DataTree"""
    def extend_at(path, index, simple_input, rest_list):
        target = path[index]
        if len(rest_list) <= target: rest_list.extend([None]*(target-len(rest_list)+1))
        if index == path.Length - 1:
            rest_list[target] = list(simple_input)
        else:
            if rest_list[target] is None: rest_list[target] = []
            extend_at(path, index+1, simple_input, rest_list[target])
    all = []
    for i in range(input.BranchCount):
        path = input.Path(i)
        extend_at(path, 0, input.Branch(path), all)
    return retrieve_base(all)

#tree=tree


#path1=[]
#for i in range(tree.BranchCount):
#    
#    path = tree.Path(i)
#    if len(path)>1 and path[1]=
#    
#    #print(path[1,-1])
#    print(path)
#    print(path[2])
#    #extend_at(path, 1, input.Branch(path), path1)

multipliedList=[]
tree_output=[]
for i in range(tree.BranchCount):
    path = tree.Path(i)
    subList=[]
    subTree=[]
    print(i)
    for ii in tree.Branch(i):
        print(path)
        subList.append(list[int(selection)])
        subTree.append(ii)
    multipliedList.append(subList)
    tree_output.append(subTree)

tree_output=list_to_tree(tree_output)
multipliedList=list_to_tree(multipliedList)
# ---------- end multiplylist_2 ----------
cloud_display_5 = CloudDisplay(Points=multiplylist_2.tree_output, Colours=multiplylist_2.multipliedList, Size=0.8, SpriteType=0)  # disabled

# ---- group: State Data / To develop averages
multiplylist_3 = GhPythonScript(tree=listtotree_2, list=gradient)  # -> tree_output, multipliedList; inputs tree: tree, list: list
# ---------- multiplylist_3: Python ----------
__author__ = "Flora"
__version__ = "2021.01.18"

import rhinoscriptsyntax as rs

#Created By piac
#from https://gist.github.com/piac/ef91ac83cb5ee92a1294
def list_to_tree(input, none_and_holes=True, source=[0]):
    """Transforms nestings of lists or tuples to a Grasshopper DataTree"""
    from Grasshopper import DataTree as Tree
    from Grasshopper.Kernel.Data import GH_Path as Path
    from System import Array
    def proc(input,tree,track):
        path = Path(Array[int](track))
        if len(input) == 0 and none_and_holes: tree.EnsurePath(path); return
        for i,item in enumerate(input):
            if hasattr(item, '__iter__'): #if list or tuple
                track.append(i); proc(item,tree,track); track.pop()
            else:
                if none_and_holes: tree.Insert(item,path,i)
                elif item is not None: tree.Add(item,path)
    if input is not None: t=Tree[object]();proc(input,t,source[:]);return t

#Created By piac
#from https://gist.github.com/piac/ef91ac83cb5ee92a1294
# written by Giulio Piacentino, giulio@mcneel.com
def tree_to_list(input, retrieve_base = lambda x: x[0]):
    """Returns a list representation of a Grasshopper DataTree"""
    def extend_at(path, index, simple_input, rest_list):
        target = path[index]
        if len(rest_list) <= target: rest_list.extend([None]*(target-len(rest_list)+1))
        if index == path.Length - 1:
            rest_list[target] = list(simple_input)
        else:
            if rest_list[target] is None: rest_list[target] = []
            extend_at(path, index+1, simple_input, rest_list[target])
    all = []
    for i in range(input.BranchCount):
        path = input.Path(i)
        extend_at(path, 0, input.Branch(path), all)
    return retrieve_base(all)

#tree=tree


#path1=[]
#for i in range(tree.BranchCount):
#    
#    path = tree.Path(i)
#    if len(path)>1 and path[1]=
#    
#    #print(path[1,-1])
#    print(path)
#    print(path[2])
#    #extend_at(path, 1, input.Branch(path), path1)

multipliedList=[]
tree_output=[]
for i in range(tree.BranchCount):
    path = tree.Path(i)
    subList=[]
    subTree=[]
    print(i)
    for ii in tree.Branch(i):
        subList.append(list[path[1]])
        subTree.append(ii)
    multipliedList.append(subList)
    tree_output.append(subTree)

tree_output=list_to_tree(tree_output)
multipliedList=list_to_tree(multipliedList)
# ---------- end multiplylist_3 ----------
cloud_display_6 = CloudDisplay(Points=multiplylist_3.tree_output, Colours=multiplylist_3.multipliedList, Size=0.8, SpriteType=0)  # disabled

# ---- group: State Data (continued)
panel_16 = Panel(tree_branch)

# ==== cluster PDB_Reader
panel = Panel("C:\Users\Flora\OneDrive - The Alan Turing Institute\Turing\1.Projects\3.Protein_folding\1.Data\GlyP_AMP.pdb")
pdb_path = ClusterInput()
ghpython_script = GhPythonScript(path=panel)  # -> out, contents
# ---------- ghpython_script: Python ----------
__author__ = "Flora"
__version__ = "2021.04.13"

import rhinoscriptsyntax as rs
contents = []
with open(path, 'r') as fp:
    #contents = fp.read()
    for cnt, line in enumerate(fp):
        contents.append(line)


fp.close()
# ---------- end ghpython_script ----------

# ---- group: PDB Reader / PDB reader
pdb_path_2 = FilePath(pdb_path)
file = ReadFile(PerLineParse=True)
pdb_open = PDBOpen(protein_data_base_file=pdb_path_2, index=0)  # -> protein_data_selected, protein_data_all
filter_dbd = GhPythonScript(PDB=ghpython_script.contents)  # -> P, TER
# ---------- filter_dbd: Python ----------
"""Script to clean PDB files.
    Inputs:
        x: The x script variable
        y: The y script variable
    Output:
        a: The a P variable"""

__author__ = "Flora"
__version__ = "2020.10.23"

import rhinoscriptsyntax as rs

PDB = PDB.replace("            ",",")
PDB = PDB.replace("           ",",")
PDB = PDB.replace("          ",",")
PDB = PDB.replace("         ",",")
PDB = PDB.replace("        ",",")
PDB = PDB.replace("       ",",")
PDB = PDB.replace("      ",",")
PDB = PDB.replace("     ",",")
PDB = PDB.replace("    ",",")
PDB = PDB.replace("   ",",")
PDB = PDB.replace("  ",",")
PDB = PDB.replace(" ",",")
#PDB = PDB.replace("TER,","")

if PDB.find("TER"):
    P = PDB
# ---------- end filter_dbd ----------
num = Number([-1, -2])
cull_i = CullIndex(List=filter_dbd.P, Indices=num, Wrap=True)
split = TextSplit(Text=cull_i, Separators=",")

# ---- group: PDB Reader / Atoms_XYZ
z = ListItem(List=split, Index="8", Wrap=True)  # -> flatten(Item)
y = ListItem(List=split, Index="7", Wrap=True)  # -> flatten(Item)
x = ListItem(List=split, Index="6", Wrap=True)  # -> flatten(Item)
num_2 = Number(z)
num_3 = Number(y)
num_4 = Number(x)
pt = ConstructPoint(XCoordinate=num_4, YCoordinate=num_3, ZCoordinate=num_2)

# ---- group: PDB Reader / Atoms_name
item = ListItem(List=split, Index="2", Wrap=True)  # -> flatten(Item)

# ---- group: PDB Reader / Atoms_order
atom_order = ListItem(List=split, Index="1", Wrap=True)  # -> flatten(Item)
atom_order_2 = Number(atom_order)

# ---- group: PDB Reader / AA_number
amino_acid = ListItem(List=split, Index="5", Wrap=True)  # -> flatten(Item)
aa_number = Number(amino_acid)

# ----
atoms_name = Text(item)
aa_number_2 = ClusterOutput(aa_number)
atoms_name_2 = ClusterOutput(atoms_name)
atom_order_3 = ClusterOutput(atom_order_2)
xyz_point = ClusterOutput(pt)

# ---- group: PDB Reader / AA_name
item_2 = ListItem(List=split, Index="3", Wrap=True)  # -> flatten(Item)

# ----
aa_name = Text(item_2)

# ---- group: PDB Reader / AA_name (continued)
panel_2 = Panel(aa_name)

# ----
aa_name_2 = ClusterOutput(aa_name)

# ==== cluster StateReader
path = ClusterInput()
data = ReadFile(PerLineParse=True)
ghpython_script = GhPythonScript(path=path)  # -> out, contents; same code as ghpython_script
num = Number(0)
cull_i = CullIndex(List=ghpython_script.contents, Indices=num, Wrap=True)
split = TextSplit(Text=cull_i, Separators=",")

end_aa = ListItem(List=split, Index="2", Wrap=True)  # -> flatten(Item)
start_aa = ListItem(List=split, Index="1", Wrap=True)  # -> flatten(Item)
start_aa_2 = Number(start_aa)
end_aa_2 = Number(end_aa)

centre = ListItem(List=split, Index="10", Wrap=True)  # -> flatten(Item)
exposure = ListItem(List=split, Index="9", Wrap=True)  # -> flatten(Item)
uptake = ListItem(List=split, Index="12", Wrap=True)  # -> flatten(Item)
uptake_2 = Number(uptake)
centre_2 = Number(centre)
exposure_2 = Number(exposure)

state = ListItem(List=split, Index="8", Wrap=True)  # -> flatten(Item)
state_2 = Text(state)
start_aa_3 = ClusterOutput(start_aa_2)
end_aa_3 = ClusterOutput(end_aa_2)
state_3 = ClusterOutput(state_2)
centre_3 = ClusterOutput(centre_2)
uptake_3 = ClusterOutput(uptake_2)
exposure_3 = ClusterOutput(exposure_2)

# ==== cluster Cluster
tree = ClusterInput()
tree_statistics = TreeStatistics(Tree=tree)  # -> Paths, Length, Count
domain = ClusterInput()
sub_list = SubList(List=tree_statistics.Paths, Domain=domain, Wrap=True)  # -> List, Index
tree_branch = TreeBranch(Tree=tree, Path=sub_list.List, MaintainPaths=True)
branch = ClusterOutput(tree_branch)

# ==== cluster ProteinRibbon: visualizes the structure of a protein
panel = Panel("C:\Users\Flora\OneDrive - The Alan Turing Institute\Turing\1.Projects\3.Protein_folding\1.Data\GlyP_AMP.pdb")
path_to_pdb_file = ClusterInput()
location = ClusterInput()
threshold_count = ClusterInput()  # threshold count for # consequtive residues for seconary structure
threshold_angle_α_vs_β = ClusterInput()  # in radians
alpha_helix_color = ClusterInput()
beta_sheet_color = ClusterInput()
loop_color = ClusterInput()
path = FilePath(panel)

# ---- group: parsing if PDB file
file = ReadFile(File=path, PerLineParse=True)
split = TextSplit(Text=file, Separators="A")
item = ListItem(List=split, Index=-1, Wrap=True)
trim = TextTrim(Text=item, Start=True, End=True)
split_2 = TextSplit(Text=trim, Separators=" ")
pdb = ImportPDB(File=path)  # -> Atoms, Bonds

# ---- group: parsing if PDB data
split_3 = TextSplit(Text=path, Separators="A")
item_2 = ListItem(List=split_3, Index=-1, Wrap=True)
trim_2 = TextTrim(Text=item_2, Start=True, End=True)
split_4 = TextSplit(Text=trim_2, Separators=" ")
num = Number(split_4)
clean = CleanTree(RemoveNulls=True, RemoveInvalid=True, RemoveEmpty=True, Tree=num)
item_3 = ListItem(List=clean, Index=1, Wrap=True)  # -> Item, Item1, Item2
pt = ConstructPoint(XCoordinate=item_3.Item, YCoordinate=item_3.Item1, ZCoordinate=item_3.Item2)  # -> flatten(Point)

# ---- group: is it a PDB file or PDB data?
null = NullItem(Item=file)  # -> NullFlags, InvalidFlags, Description
item_4 = ListItem(List=flatten(null.NullFlags), Index=0, Wrap=True)
filter = StreamFilter(Gate=item_4, Stream0=split_2, Stream1=split_4)
filter_2 = StreamFilter(Gate=item_4, Stream0=pdb.Atoms, Stream1=pt)

# ----
# Secondary structure creation via DSSP algorithm in Grasshopper. (Needs reviewing)
# Modified ALBA plug-in.
aapoints = ClusterInput()

# ---- group: reduce all atom points to AA residue points
item_5 = ListItem(List=filter, Index=0, Wrap=True)
int = Integer(item_5)
clean_2 = CleanTree(RemoveNulls=True, RemoveInvalid=True, RemoveEmpty=True, Tree=int)
subtraction = Subtraction(A=clean_2, B=1)
tstat = TreeStatistics(Tree=graft(filter_2))  # -> Paths, Length, Count
path_2 = ConstructPath(Indices=subtraction)  # -> flatten(Branch)
replace = ReplacePaths(Data=graft(filter_2), Search=tstat.Paths, Replace=path_2)
pt_2 = Point(aapoints)
item_6 = ListItem(List=pt_2, Index=0, Wrap=True)

# ---- group: create a polyline from the AA residue points and analize angles to find helixes
pline = PolyLine(Vertices=flatten(item_6), Closed=False)
disc = Discontinuity(Curve=pline, Level=1)  # -> Points, Parameters
eval = EvaluateCurve(Curve=pline, Parameter=disc.Parameters)  # -> Point, Tangent, Angle
ta = Number(threshold_angle_α_vs_β)
larger = LargerThan(FirstNumber=eval.Angle, SecondNumber=ta)  # -> LargerThan, OrEqualTo

# ---- group: domains of secondary structures
lng = ListLength(List=larger.LargerThan)
shift = ShiftList(List=larger.LargerThan, Shift=1, Wrap=True)
series = Series(Start=0, Step=1, Count=lng)
equals = Equality(FirstNumber=larger.LargerThan, SecondNumber=shift)  # -> Equality, Inequality
int_2 = Integer(series)
subtraction_2 = Subtraction(A=lng, B=1)
dispatch = Dispatch(List=int_2, DispatchPattern=equals.Equality)  # -> ListA, ListB
ins = InsertItems(List=dispatch.ListB, Item=subtraction_2, Indices=-1, Wrap=True)
ins_2 = InsertItems(List=ins, Item=0, Indices=0, Wrap=True)
consec = ConsecutiveDomains(Numbers=ins_2, Additive=False)

# ---- group: break ribbon into secondary structures / determine sizes of secondary structure to distinguish between 1) alpha helixes and beta sheets or 2) loops
dedomain = DeconstructDomain(Domain=consec)  # -> Start, End
subtraction_3 = Subtraction(A=dedomain.End, B=dedomain.Start)
tc = Number(threshold_count)
larger_2 = LargerThan(FirstNumber=subtraction_3, SecondNumber=tc)  # -> LargerThan, OrEqualTo

# ---- group: break ribbon into secondary structures / points divided into secondary structure
subset = SubList(List=flatten(item_6), Domain=consec, Wrap=True)  # -> List, Index

# ----
tweek_orientation = Slider(0, range=0..10)

# ---- group: seperate helixes from sheets / is this the domain of an alpha helix?
dedomain_2 = DeconstructDomain(Domain=consec)  # -> Start, End
dom = ConstructDomain(DomainStart=expr("x+1", dedomain_2.Start), DomainEnd=dedomain_2.End)
subset_2 = SubList(List=flatten(larger.LargerThan), Domain=dom, Wrap=True)  # -> List, Index
item_7 = ListItem(List=subset_2.List, Index=0, Wrap=True)

# ----
pln = Plane(location)

# ---- group: seperate helixes and sheets from loops
dispatch_2 = Dispatch(List=subset.List, DispatchPattern=graft(larger_2.LargerThan))  # -> ListA, ListB

# ---- group: seperate helixes from sheets
dispatch_3 = Dispatch(List=dispatch_2.ListA, DispatchPattern=item_7)  # -> ListA, ListB

# ----
loop_points = Point(dispatch_2.ListB)
alph_helix_points = Point(dispatch_3.ListA)
beta_sheet_points = Point(dispatch_3.ListB)

intcrv = Interpolate(Vertices=beta_sheet_points, Degree=3, Periodic=False, KnotStyle=1)  # -> Curve, Length, Domain
intcrv_2 = Interpolate(Vertices=alph_helix_points, Degree=3, Periodic=False, KnotStyle=1)  # -> Curve, Length, Domain
intcrv_3 = Interpolate(Vertices=loop_points, Degree=3, Periodic=False, KnotStyle=1)  # -> Curve, Length, Domain
merge = Merge(Data1=intcrv_2.Curve, Data2=intcrv.Curve, Data3=intcrv_3.Curve)  # -> simplify(Result)
curve = ClusterOutput(merge)

clean_3 = CleanTree(RemoveNulls=True, RemoveInvalid=True, RemoveEmpty=True, Tree=intcrv_3.Curve)  # -> simplify(Tree)

# ---- group: loops
pipe = Pipe(Curve=clean_3, Radius=Slider(0.24, range=0..1), Caps=2)  # -> simplify(Pipe)
L = Shader(loop_color)
preview = CustomPreview(Geometry=pipe, Shader=L)

# ---- group: script that hides all outputs
c_script = CSharpScript()  # -> out; inputs Trigger: tree
# ---------- c_script: C# ----------
    // No code needed here.
# ---------- c_script: C# additional code ----------
  /// <summary>
  /// This method will be called once every solution, before any calls to RunScript.
  /// </summary>
  public override void BeforeRunScript()
  {
    if (GrasshopperDocument == null)
      return;
    
    // Get the owner (if any) of this document.
    IGH_DocumentOwner owner = GrasshopperDocument.Owner;
    if (owner == null)
      return;

    // See if the object owning this document is a cluster.
    IGH_Component cluster = owner as IGH_Component;
    if (cluster == null)
      return;

    // Iterate over all outputs.
    foreach (IGH_Param param in cluster.Params.Output)
    {
      IGH_PreviewObject previewParameter = param as IGH_PreviewObject;
      if (previewParameter != null)
        previewParameter.Hidden = true;
    }
  }
# ---------- end c_script ----------

# ---- group: orient the protein with the first helix or sheet aligned to the Z axis, with the midddle AA residue at the origin, and the middle AA residue of the last helix or sheet on the X axis / determine orientation
dispatch_4 = Dispatch(List=subset.List, DispatchPattern=graft(larger_2.LargerThan))  # -> ListA, ListB
clean_4 = CleanTree(RemoveNulls=True, RemoveInvalid=True, RemoveEmpty=True, Tree=dispatch_4.ListA)
browse = BranchBrowser(T=clean_4, i=tweek_orientation)
item_8 = ListItem(List=flatten(browse), Index=-1, Wrap=True)

# ----
lng_2 = ListLength(List=browse)  # -> expr("x/2", Length)

# ---- group: orient the protein with the first helix or sheet aligned to the Z axis, with the midddle AA residue at the origin, and the middle AA residue of the last helix or sheet on the X axis / determine orientation (continued)
item_9 = ListItem(List=flatten(browse), Index=lng_2, Wrap=True)

# ----
vec2pt = Vector2Pt(PointA=item_9, PointB=item_8, Unitize=False)  # -> Vector, Length
pl = PlaneNormal(Origin=item_9, ZAxis=vec2pt.Vector)

# ---- group: orient the protein with the first helix or sheet aligned to the Z axis, with the midddle AA residue at the origin, and the middle AA residue of the last helix or sheet on the X axis / orient AA residues
orient = Orient(Geometry=subset.List, Source=pl, Target=pln)  # -> Geometry, Transform
simplify = SimplifyTree(Tree=orient.Geometry, Front=False)
amino_acid_residue_points = ClusterOutput(simplify)

# ---- group: orient the protein with the first helix or sheet aligned to the Z axis, with the midddle AA residue at the origin, and the middle AA residue of the last helix or sheet on the X axis / orient atoms
orient_2 = Orient(Geometry=pt_2, Source=pl, Target=pln)  # -> simplify(Geometry), Transform
all_atom_points = ClusterOutput(orient_2.Geometry)

# ---- group: beta sheets
clean_5 = CleanTree(RemoveNulls=True, RemoveInvalid=True, RemoveEmpty=True, Tree=intcrv.Curve)  # -> simplify(Tree)

curvepoint = PointOnCurve(clean_5, parameter=0.5)
shift_2 = ShiftList(List=flatten(curvepoint), Shift=1, Wrap=True)  # -> graft(List)
vec2pt_2 = Vector2Pt(PointA=curvepoint, PointB=shift_2, Unitize=False)  # -> Vector, Length
pframe = PerpFrame(Curve=clean_5, Parameter=Slider(0, range=0..0.01))
align = AlignPlane(Plane=pframe, Direction=vec2pt_2.Vector)  # -> Plane, Angle

len = Length(Curve=clean_5)
subtraction_4 = Subtraction(A=len, B=Slider(2, range=0..10))

rectangle = Rectangle(Plane=align.Plane, XSize=Domain(-1.25, 1.25), YSize=Domain(-0.25, 0.25), Radius=0.1)  # -> Rectangle, Length
subcrv = SubCurve(BaseCurve=clean_5, Domain=subtraction_4)
swp1 = Sweep1(Rail=subcrv, Sections=rectangle.Rectangle, Miter=1)  # -> simplify(Brep)
edges = BrepEdges(Brep=swp1)  # -> Naked, Interior, NonManifold
item_10 = ListItem(List=edges.Naked, Index=0, Wrap=True)
offset_out = OffsetOut(curve=item_10, distance_or_xylinus_config=Slider(0.4, range=0..1))
end = EndPoints(Curve=clean_5)  # -> Start, End
extr = ExtrudePoint(Base=offset_out, Point=end.End)  # -> simplify(Extrusion)
β = Shader(beta_sheet_color)
cap = CapHoles(Brep=simplify([swp1, extr]))
sunion = SolidUnion(Breps=cap)

preview_2 = CustomPreview(Geometry=sunion, Shader=β)

# ---- group: alpha helices
clean_6 = CleanTree(RemoveNulls=True, RemoveInvalid=True, RemoveEmpty=True, Tree=intcrv_2.Curve)  # -> simplify(Tree)
pframe_2 = PerpFrame(Curve=clean_6, Parameter=0)
rectangle_2 = Rectangle(Plane=pframe_2, XSize=Domain(-0.25, 0.25), YSize=Domain(-1.25, 1.25), Radius=0.2)  # -> Rectangle, Length
α = Shader(alpha_helix_color)

# ----
extrcrv = ExtrudeAlong(Base=rectangle_2.Rectangle, Curve=clean_6)
cap_2 = CapHoles(Brep=extrcrv)  # -> simplify(Brep)

# ---- group: alpha helices (continued)
preview_3 = CustomPreview(Geometry=cap_2, Shader=α)

# ----
entwine = Entwine(Branch00=cap_2, Branch01=sunion, Branch02=pipe, FlattenInputs=True)
geo = Geometry(entwine)
ribbon = ClusterOutput(geo)

# ==== cluster Cluster_2
panel = Panel("""0
1
2""")
ui_elements = ClusterInput()
create_grid = CreateGrid(
    UIElements=ui_elements,
    RowDefinitions=[Slider(37, range=0..1000), Slider(37, range=0..1000), Slider(53, range=0..400)],
    ColumnDefinitions=Slider(211, range=0..1000),
    ElementRow=panel,
    ElementRowSpan=1,
    ElementColumnSpan=1)
grid = ClusterOutput(create_grid)

# ==== cluster PDBOpen: make the pdb info accessible
protein_data_base_file = ClusterInput()  # Input the path to a local PDB file, the URL of a PDB file online, or the ID or a PDB file in the RCSB database.
index = ClusterInput()  # If the PDB file has multiple proteins listed, you may choose one.

# ---- group: only one item may be passed
data = Data(protein_data_base_file)
item = ListItem(List=data, Index=0, Wrap=True)
path = FilePath(item)

# ---- group: detrmine if the passed info is a URL (2), a local file path (1) or a Protein ID
concat = Concatenate(FragmentA="http://www.rcsb.org/pdb/files/", FragmentB=path, FragmentC=".pdb")

tmatch = MatchText(Text=path, Pattern="*:*", Case=True)

tmatch_2 = MatchText(Text=path, RegEx="http://", Case=True)
addition = Addition(A=tmatch, B=tmatch_2)
filter = StreamFilter(Gate=addition, Stream0=concat, Stream2=path)
url = CSharpScript(url=filter, L=True)  # -> out, C; inputs url: String, L: Boolean
# ---------- url: C# ----------
    //turn caching on and off
    bool cache = true;

    if(url == "") return;

    //everything in here is cached unless a parameter changes or cache is off.
    if(cache == false || (cache == true && (url != pastURL || L != pastAsLines)))
    {
      Print("getting url");

      //cache the parameters
      pastURL = url;
      pastAsLines = L;

      //must have http to work with webclient.
      if( !url.StartsWith("http://"))
      {
        url = "http://" + url;
      }

      //open url and read to string.
      System.Net.WebClient Client = new System.Net.WebClient ();
      Stream strm = Client.OpenRead(url);
      StreamReader sr = new StreamReader(strm);

      //L = read individual lines.
      if(L)
      {
        List<string> dataList = new List<string>();
        string line;

        do
        {
          line = sr.ReadLine();
          dataList.Add(line);
        }
        while (line != null);

        C = dataList;

      } else //just read as a block
      {
        string dataString = "";
        string line;

        do
        {
          line = sr.ReadLine();
          dataString += line;
        }
        while (line != null);

        C = dataString;
      }

      strm.Close();
      sr.Close();

      pastResult = C;

    } else {//used cached result.
      C = pastResult;
    }
# ---------- url: C# additional code ----------
  string pastURL = "";
  bool pastAsLines = false;
  object pastResult = null;
# ---------- end url ----------

xor = GateXor(A=flatten(tmatch), B=flatten(tmatch_2))
filter_2 = StreamFilter(Gate=xor, Stream1=path)
file = ReadFile(File=filter_2, PerLineParse=True)

filter_3 = StreamFilter(Gate=addition, Stream0=url.C, Stream1=file, Stream2=url.C)

# ----
tmatch_3 = MatchText(Text=filter_3, RegEx="TER", Case=True)
mindex = MemberIndex(Set=tmatch_3, Member=True)  # -> Index, Count
shift = ShiftList(List=mindex.Index, Shift=1, Wrap=False)
dom = ConstructDomain(DomainStart=mindex.Index, DomainEnd=shift)
subset = SubList(List=filter_3, Domain=dom, Wrap=True)  # -> List, Index
tmatch_4 = MatchText(Text=subset.List, RegEx="ATOM", Case=True)
cull = CullPattern(List=subset.List, CullPattern=tmatch_4)
prune = PruneTree(Tree=cull, Minimum=100, Maximum=0)
tstat = TreeStatistics(Tree=prune)  # -> Paths, Length, Count
series = Series(Start=0, Step=1, Count=tstat.Count)
replace = ReplacePaths(Data=prune, Search=tstat.Paths, Replace=series)
browse = BranchBrowser(T=simplify(replace), i=index)
protein_data_selected = ClusterOutput(browse)
protein_data_all = ClusterOutput(replace)

# ==== cluster OffsetOut: Offset curves outward. Use for interior curves.
curve = ClusterInput()  # Curves to offset outwards.
distance_or_xylinus_config = ClusterInput()  # Distance to offset curve. If a config is input, the offset distance will be 1/2 the extrusion width.

# ---- group: if fed a config use 1/2 extrusion width, otherwise pass data
data = Data(distance_or_xylinus_config)
item = ListItem(List=data, Index=0, Wrap=True)
item_2 = ListItem(List=data, Index="3", Wrap=True)
box = Box(item)
division = Division(A=item_2, B=2)
null = NullItem(Item=box)  # -> NullFlags, InvalidFlags, Description
filter = StreamFilter(Gate=null.NullFlags, Stream0=division, Stream1=data)
distance = Number(filter)

# ---- group: interior
crv = Curve(curve)

# ----
number_slider = Slider(2, range=0..4)

# ---- group: run a test offset and check to see if it is bigger
D = Number(distance)
offset = Offset(Curve=crv, Distance=D, Plane=PlaneXY(0, 0, 0), Corners=number_slider)
trim = TrimTree(Tree=offset, Depth=1)
area = Area(Geometry=trim)  # -> Area, Centroid
area_2 = Area(Geometry=crv)  # -> Area, Centroid
larger = LargerThan(FirstNumber=area.Area, SecondNumber=area_2.Area)  # -> LargerThan, OrEqualTo

# ---- group: use test offset to determine the direction of the final offset
D_2 = Number(distance)
long = LongestList(ListA=larger.LargerThan, ListB=D_2, PaddingMode=2)  # -> ListA, ListB
neg = Negative(Value=long.ListB)
p_n_c = PickNChoose(Pattern=larger.LargerThan, Stream0=neg, Stream1=long.ListB)
offset_2 = Offset(Curve=crv, Distance=p_n_c, Plane=PlaneXY(0, 0, 0), Corners=number_slider)
trim_2 = TrimTree(Tree=offset_2, Depth=1)

# ---- group: double check and just ditch what isn't right
area_3 = Area(Geometry=trim_2)  # -> Area, Centroid
area_4 = Area(Geometry=crv)  # -> Area, Centroid
larger_2 = LargerThan(FirstNumber=area_3.Area, SecondNumber=area_4.Area)  # -> LargerThan, OrEqualTo
dispatch = Dispatch(List=trim_2, DispatchPattern=larger_2.LargerThan)  # -> ListA, ListB
crv_2 = Curve(dispatch.ListB)

# ---- group: double check and just ditch what isn't right / good interior offsets
crv_3 = Curve(dispatch.ListA)

# ----
offset_cruves = ClusterOutput(crv_3)

# ==== cluster BranchBrowser: allows you to scroll through the branchs of the tree sequentially using an integer instead of a path
T = ClusterInput()
i = ClusterInput()
tstat = TreeStatistics(Tree=T)  # -> Paths, Length, Count
item = ListItem(List=tstat.Paths, Index=i, Wrap=True)
branch = TreeBranch(Tree=T, Path=item, MaintainPaths=True)
B = ClusterOutput(branch)
