# Grasshopper definition testUI.gh (Grasshopper 1.0.7)
# plug-ins: Human UI

cluster = Cluster()
cluster_2 = Cluster()
cluster_3 = Cluster()
cluster_4 = Cluster()
cluster_5 = Cluster()
cluster_6 = Cluster()
cluster_7 = Cluster()
merge = Merge(
    Data1=flatten(cluster_2),
    Data2=flatten(cluster_5),
    Data3=flatten(cluster_7),
    Data4=flatten(cluster_6),
    Data5=flatten(cluster_4),
    Data6=flatten(cluster_3),
    Data7=flatten(cluster))

panel = Panel("""0
0
0
1
1
1
2
2
2""")
panel_2 = Panel("""0
1
2
0
1
2
0
1
2
0
1
2""")
create_grid = CreateGrid(
    UIElements=merge,
    Width=Slider(5704, range=0..10000),
    Height=Slider(6001, range=0..10000),
    RowDefinitions=[Slider(261, range=0..1000), Slider(213, range=0..1000), Slider(67, range=0..100)],
    ColumnDefinitions=[Slider(342, range=0..1000), Slider(246, range=0..1000), Slider(576, range=0..1000)],
    ElementRow=panel,
    ElementColumn=panel_2,
    ElementRowSpan=1,
    ElementColumnSpan=1)
adjust_element_positioning = AdjustElementPositioning(
    ElementsToAdjust=create_grid,
    Margin="30,30,0,0",
    AbsolutePositioning=False,
    Width=Slider(1564, range=0..10000),
    Height=Slider(802, range=0..1000))

create_stack = CreateStack(Horizontal=True)
create_expander = CreateExpander(Open=True)
activate_interface = BooleanToggle(False)
create_expander_2 = CreateExpander(UIElements=create_grid, Open=True)
launch_window = LaunchWindow(
    Show=activate_interface,
    Name="Control Window",
    Width=Slider(1000, range=0..1000),
    Height=Slider(724, range=0..1000),
    ChildStatus=0,
    EnableHorizScroll=False)
add_elements = AddElements(Window=launch_window, Elements=flatten(create_expander_2), DoVLChecking=True)  # -> AddedElements, ElementNames

# ==== cluster Cluster
mesh_sphere = MeshSphere(Base=PlaneXY(0, 0, 0), Radius=10, UCount=10, VCount=20)
create_3d_view = Create3DView(
    MeshToDisplay=mesh_sphere,
    MeshColors=RGB(255, 0, 0),
    ViewWidth=Slider(132, range=0..1000),
    ViewHeight=Slider(108, range=0..1000))
sphere = Sphere(Base="0,0,0", Radius=Slider(5, range=0..10))
_3dview = ClusterOutput(create_3d_view)
set_3d_view = Set3DView(_3DView=create_3d_view, MeshToDisplay=sphere)
